# Grasshopper definition Tower.gh (Grasshopper 1.0.8)
# plug-ins: Wombat

m_objects = QueryModelObjects(Layer="02_Tower_Base", Locked=True, Hidden=True, AutoUpdateState=True)
crv = Curve(m_objects)
explode = Explode(Curve=crv, Recursive=True)  # -> Segments, Vertices
area = Area(Geometry=crv)  # -> Area, Centroid
item = ListItem(List=explode.Segments, Index=0, Wrap=True)
mp = Midpoint(Curve=item)
ln = Line(StartPoint=area.Centroid, EndPoint=mp)
pl = ConstructPlane(Origin=area.Centroid, XAxis=ln, YAxis=Vector(0, 1, 0))
number_slider = Slider(19.8, range=15..30)
number_slider_2 = Slider(15, range=15..30)
dom = ConstructDomain(DomainStart=expr("-x", number_slider), DomainEnd=number_slider)
dom_2 = ConstructDomain(DomainStart=expr("-x", number_slider_2), DomainEnd=number_slider_2)
rectangle = Rectangle(Plane=pl, XSize=dom, YSize=dom_2, Radius=0)  # -> Rectangle, Length

number_slider_3 = Slider(61, range=5..70)
number_slider_4 = Slider(3.6, range=2.9..5)

series = Series(Start=0, Step=number_slider_4, Count=number_slider_3)
series_2 = Series(Start=0, Step=Slider(2.7, range=0..5), Count=number_slider_3)
Z = UnitZ(Factor=series)
move = Move(Geometry=rectangle.Rectangle, Motion=Z)  # -> Geometry, Transform
area_2 = Area(Geometry=move.Geometry)  # -> Area, Centroid
lng = ListLength(List=area_2.Centroid)
range = Range(Domain=Domain(0, 1), Steps=expr("x-1", lng))
graph = GraphMapper(
    range,
    x0=0,
    x1=1,
    y0=0,
    y1=1,
    container_name="Bezier",
    cpx=[0, 0.738173306, 0.605435133, 1],
    cpy=[0.2548726201, 0.008803665638, 0.06793481112, 1])
crv_2 = Curve(move.Geometry)
dom_3 = ConstructDomain(DomainStart=Slider(0.81, range=0..1), DomainEnd=Slider(0.563, range=0..1))
remap = RemapNumbers(Value=graph, Source=Domain(0, 1), Target=dom_3)  # -> Mapped, Clipped
scale = Scale(Geometry=crv_2, Center=area_2.Centroid, Factor=remap.Mapped)  # -> Geometry, Transform
num = Number(series_2)
rotate = Rotate(Geometry=scale.Geometry, Angle=degrees(num), Plane=area_2.Centroid)  # -> Geometry, Transform
boundary = BoundarySurfaces(Edges=rotate.Geometry)
Z_2 = UnitZ(Factor=number_slider_4)
extr = Extrude(Base=boundary, Direction=Z_2)
cluster = Cluster(V=Slider(0.823, range=0..1), L=extr)
cluster_2 = Cluster(V=Slider(0.62, range=0..1), L=extr)
cluster_3 = Cluster(V=Slider(0.36, range=0..1), L=extr)
cluster_4 = Cluster(V=Slider(0.135, range=0..1), L=extr)
py3 = Python3Script(data=extr, i1=cluster, i2=cluster_2, i3=cluster_3, i4=cluster_4)  # -> out1, out2, out3, out4; inputs data: list
# ---------- py3: Python ----------
indices = sorted([int(i1), int(i2), int(i3)])

indices = [max(0, min(len(data), i)) for i in indices]


out1 = data[:indices[0]]
out2 = data[indices[0]:indices[1]]
out3 = data[indices[1]:indices[2]]
out4 = data[indices[2]:]
# ---------- end py3 ----------
custom_preview = CustomPreview(Geometry=py3.out1, Material=ColourSwatch(SwatchColor=RGB(255, 94, 8)))
custom_preview_2 = CustomPreview(Geometry=py3.out2, Material=ColourSwatch(SwatchColor=RGB(181, 8, 255)))
custom_preview_3 = CustomPreview(Geometry=py3.out3, Material=ColourSwatch(SwatchColor=RGB(8, 94, 255)))
custom_preview_4 = CustomPreview(Geometry=py3.out4, Material=ColourSwatch(SwatchColor=RGB(255, 222, 8)))
data = Data(simplify(graft(extr)))
tstat = TreeStatistics(Tree=data)  # -> Paths, Length, Count
data_2 = Data(simplify(data))
debrep = DeconstructBrep(Brep=data_2)  # -> Faces, Edges, Vertices
panel = Panel("""Floor
Type
GFA
Facade Area""")
area_3 = Area(Geometry=debrep.Faces)  # -> Area, Centroid
pdecon = Deconstruct(Point=area_3.Centroid)  # -> XComponent, YComponent, ZComponent
join = TextJoin(Text=panel, Join="_")
lng_2 = ListLength(List=py3.out1)
lng_3 = ListLength(List=py3.out2)
lng_4 = ListLength(List=py3.out3)
lng_5 = ListLength(List=py3.out4)
sort = SortList(Keys=pdecon.ZComponent, ValuesA=debrep.Faces)  # -> Keys, ValuesA
dup = DuplicateData(Data=join, Number=tstat.Count, Order=True)  # -> graft(Data)
panel_2 = Panel("""0
-1""")
dup_2 = DuplicateData(Data="Retail", Number=lng_2, Order=True)
dup_3 = DuplicateData(Data="Office", Number=lng_3, Order=True)
dup_4 = DuplicateData(Data="Hospitality", Number=lng_4, Order=True)
dup_5 = DuplicateData(Data="Retai", Number=lng_5, Order=True)
item_2 = ListItem(List=sort.ValuesA, Index=0, Wrap=True)  # -> simplify(Item)
cull_i = CullIndex(List=sort.ValuesA, Indices=panel_2, Wrap=True)
tstat_2 = TreeStatistics(Tree=data_2)  # -> Paths, Length, Count
split = TextSplit(Text=dup, Separators="_")  # -> simplify(Result)
merge = Merge(Data1=dup_2, Data2=dup_3, Data3=dup_4, Data4=dup_5)  # -> graft(Result)
area_4 = Area(Geometry=cull_i)  # -> Area, Centroid
series_3 = Series(Start=0, Step=1, Count=tstat_2.Count)  # -> graft(Series)
data_3 = Data(split)
ma = MassAddition(Input=area_4.Area)  # -> simplify(Result), PartialResults
area_5 = Area(Geometry=item_2)  # -> Area, Centroid
int = Integer(area_5.Area)
int_2 = Integer(ma.Result)
panel_3 = Panel(series_3)
merge_2 = Merge(Data1=simplify(series_3), Data2=simplify(merge), Data3=simplify(int), Data4=simplify(int_2))
ma_2 = MassAddition(Input=flatten(area_5.Area))  # -> Result, PartialResults
panel_4 = Panel(data_3)
panel_5 = Panel(merge_2)
panel_6 = Panel(ma_2.Result)
py3_2 = Python3Script(keys=panel_4, values=panel_5)  # -> out, a; inputs keys: tree, values: tree
# ---------- py3_2: Python ----------
import json

result = []

branch_count = min(keys.BranchCount, values.BranchCount)

for i in range(branch_count):
    k_branch = keys.Branch(i)
    v_branch = values.Branch(i)

    d = {}
    item_count = min(len(k_branch), len(v_branch))

    for j in range(item_count):
        k = str(k_branch[j]).strip()
        v = v_branch[j]

        try:
            s = str(v)
            if "." in s:
                v = float(v)
            else:
                v = int(v)
        except Exception:
            v = str(v)

        d[k] = v

    result.append(d)

# outputs
a = json.dumps(result, indent=2, ensure_ascii=False)  # JSON text
b = result                                             # Python list of dicts
# ---------- end py3_2 ----------
py3_3 = Python3Script(keys=panel_4, values=panel_5, filePath="C:\Users\mscigaj\Desktop\Work\00_Hackhathon\data.json", write=Button())  # -> a, b; inputs keys: tree, values: tree
# ---------- py3_3: Python ----------
import json
import os

# build result (your existing logic)
result = []

branch_count = min(keys.BranchCount, values.BranchCount)

for i in range(branch_count):
    k_branch = keys.Branch(i)
    v_branch = values.Branch(i)

    d = {}
    item_count = min(len(k_branch), len(v_branch))

    for j in range(item_count):
        k = str(k_branch[j])
        v = v_branch[j]

        try:
            if "." in str(v):
                v = float(v)
            else:
                v = int(v)
        except:
            v = str(v)

        d[k] = v

    result.append(d)

# convert to json
jsonText = json.dumps(result, indent=2)

path = str(filePath).strip()

if write and path:

    folder = os.path.dirname(path)

    if folder != "" and not os.path.exists(folder):
        os.makedirs(folder)

    with open(path, "w") as f:
        f.write(jsonText)

# outputs
a = jsonText
b = result
c = path
# ---------- end py3_3 ----------
panel_7 = Panel(py3_2.a)
select_graph = ValueList({"Bar Graph": 0, "Pie Graph": 1, "Tree Map": 2, "Circle Packing": 3, "Sankey Diagram": 4}, selected="Circle Packing")
py3_4 = Python3Script(graphSelection=select_graph, dataCollection=py3_2.a)  # -> out, a
# ---------- py3_4: Python ----------
"""Grasshopper Script Instance"""
import json
import Grasshopper


class data_class:
    def __init__(self, name=None, parent=None, value=None, dataType=None, description=None, tags=None):
        self.name = name if name is not None else ""
        self.parent = parent if parent is not None else "Total"
        self.value = value if value is not None else 0
        self.dataType = dataType if dataType is not None else ""
        self.description = description if description is not None else ""
        self.tags = tags if tags is not None else []

    @staticmethod
    def format_data(data, graphSelection):
        if graphSelection == 0:   # Bar
            return data_class(data.name, None, data.value)
        elif graphSelection == 1: # Pie
            return data_class(data.name, None, data.value)
        elif graphSelection == 2: # Treemap
            return data_class(data.name, data.parent, data.value)
        elif graphSelection == 3: # Circle packing
            return data_class(data.name, data.parent, data.value)
        elif graphSelection == 4: # Sankey (not implemented)
            return None
        return None


def graph_name_from_selection(selection):
    try:
        s = int(selection)
    except Exception:
        s = 2

    mapping = {
        0: "GraphName.BAR_GRAPH",
        1: "GraphName.PIE",
        2: "GraphName.TREEMAP",
        3: "GraphName.CIRCLE_PACKING",
        4: "GraphName.SANKEY_DIAGRAM",
    }
    return mapping.get(s, "GraphName.TREEMAP")


class DataCompiler(Grasshopper.Kernel.GH_ScriptInstance):
    def RunScript(self, graphSelection, dataCollection):
        """
        Inputs:
          graphSelection : int
          dataCollection : JSON string (array of objects) OR list of dicts

        Output:
          A : jsonText (payload for local server/update)
        """
        # Parse input
        if isinstance(dataCollection, str):
            txt = dataCollection.strip()
            rows_in = json.loads(txt) if txt else []
        elif isinstance(dataCollection, list):
            rows_in = dataCollection
        else:
            rows_in = []

        graph_name = graph_name_from_selection(graphSelection)
        sel = int(graphSelection) if graphSelection is not None else 2

        rows_out = []

        for item in rows_in:
            if not isinstance(item, dict):
                continue

            # Map your source schema -> chart schema
            # name: Floor (fallback to "name")
            # parent: Type (fallback to "parent")
            # value: GFA (fallback to "value")
            name = str(item.get("Floor", item.get("name", ""))).strip()
            parent = str(item.get("Type", item.get("parent", "Total"))).strip() or "Total"
            value = item.get("GFA", item.get("value", 0))

            try:
                value = float(value)
            except Exception:
                value = 0.0

            d = data_class(name=name, parent=parent, value=value)
            f = data_class.format_data(d, sel)
            if f is None or str(f.name).strip() == "":
                continue

            rows_out.append({
                "name": str(f.name),
                "parent": "Total" if f.parent is None else str(f.parent),
                "value": float(f.value),
            })

        # Canonical payload your server/frontend supports
        payload = {
            "GraphName": graph_name,
            "data": rows_out
        }

        jsonText = json.dumps(payload, indent=2, ensure_ascii=False)
        return jsonText
# ---------- end py3_4 ----------
panel_8 = Panel(py3_4.a)
py3_5 = Python3Script(seed=Slider(3, range=0..10))  # -> A, B, C
# ---------- py3_5: Python ----------
import json
import random

# GH input:
# seed : int   (Integer Slider, e.g. 0..10000)

MIN_V = 15
MAX_V = 250

if seed is None:
    seed = 0

seed = int(seed)

# deterministic RNG from seed
rng = random.Random(seed)

data = [
    {"name": "Living",  "parent": "Indoor",  "value": rng.randint(MIN_V, MAX_V)},
    {"name": "Kitchen", "parent": "Indoor",  "value": rng.randint(MIN_V, MAX_V)},
    {"name": "Bedroom", "parent": "Terrace", "value": rng.randint(MIN_V, MAX_V)},
    {"name": "Deck",    "parent": "Outdoor", "value": rng.randint(MIN_V, MAX_V)},
    {"name": "Garden",  "parent": "Outdoor", "value": rng.randint(MIN_V, MAX_V)},
    {"name": "Pool",    "parent": "Outdoor", "value": rng.randint(MIN_V, MAX_V)},
]

# GH outputs:
# A: data (list of dicts)
# B: json_text (string)
# C: values_only (list of numbers)
A = data
B = json.dumps(data, indent=2)
C = [d["value"] for d in data]
# ---------- end py3_5 ----------
py3_6 = Python3Script(data=py3_4.a, send=Toggle(True))  # -> A, B; inputs data: list, send: Boolean
# ---------- py3_6: Python ----------
import json
import hashlib
import urllib.request
import scriptcontext as sc

# GH input:
# data : list[dict]  (your treemap list: name,parent,value)
# send : bool

URL = "http://127.0.0.1:8765/update"

def stable_json(obj):
    return json.dumps(obj, ensure_ascii=False, sort_keys=True, separators=(",", ":"))

ok = False
msg = "send=False"

if send and data is not None:
    payload_text = stable_json(data)
    new_hash = hashlib.sha256(payload_text.encode("utf-8")).hexdigest()
    old_hash = sc.sticky.get("treemap_hash")

    if new_hash != old_hash:
        req = urllib.request.Request(
            URL,
            data=payload_text.encode("utf-8"),
            headers={"Content-Type": "application/json"},
            method="POST",
        )
        try:
            with urllib.request.urlopen(req, timeout=1.5) as r:
                _ = r.read()
            sc.sticky["treemap_hash"] = new_hash
            ok = True
            msg = "Posted update (changed)."
        except Exception as e:
            msg = "POST failed: {}".format(e)
    else:
        ok = True
        msg = "No change; skipped POST."

# GH outputs:
# A = ok
# B = msg
# ---------- end py3_6 ----------
panel_9 = Panel(py3_6.A)
panel_10 = Panel(py3_6.B)
panel_11 = Panel(py3_5.B)
random = Random(Range=Domain(0, 10000), Number=Slider(5, range=0..10), Seed=8)
random_2 = Random(Range=Domain(0, 10000), Number=Slider(4, range=0..10), Seed=2)
panel_12 = Panel("""tag1
tag2
tag3
tag4
tag5""")
panel_13 = Panel("""tag1
tag2
tag3""")
python_3_script = Python3Script(name="area", parent="residential", value=random, dataType="float", description="testDescription01", tags=panel_12)  # -> out, a; inputs tags: list
# ---------- python_3_script: Python ----------
"""Grasshopper Script Instance"""
import System
import Rhino
import Grasshopper

import rhinoscriptsyntax as rs
import json

class DataConstructor(Grasshopper.Kernel.GH_ScriptInstance):
    def RunScript(self,
            name,
            parent,
            value,
            dataType,
            description,
            tags: list[object]):
        data = data_class(name, parent, value, dataType, description, tags)
        byte = bytes(data)
        return byte


class data_class:

    name = ""
    parent = ""
    value = ""
    dataType = ""
    description = ""
    tags = []

    def __init__(self, name, parent, value, dataType, description, tags):

        if name is not None:
            self.name = name
        if parent is not None:
            self.parent = parent
        if value is not None:
            self.value = value
        if dataType is not None:
            self.dataType = dataType
        if description is not None:
            self.description = description
        if tags is not None:
            self.tags = tags

    def __bytes__(self):
        return json.dumps({
            "name": self.name,
            "parent": self.parent,
            "value": self.value,
            "dataType": self.dataType,
            "description": self.description,
            "tags": self.tags
        }).encode("utf-8")

    def from_bytes(data: bytes):
        d = json.loads(data.decode("utf-8"))
        return data_class(d["name"], d["parent"], d["value"], d["dataType"], d["description"], d["tags"])


    def format_data(data: "data_class", graphSelection):

        if graphSelection == 0: #Bar Graph
            return data_class.format_bar_chart(data)
        
        elif graphSelection == 1: #Pie Chart
            return data_class.format_pie_chart(data)
        
        elif graphSelection == 2: #Tree Map
            return data_class.format_tree_map(data)
        
        elif graphSelection == 3: #Circle Packing
            return data_class.format_circle_packing(data)
        
        elif graphSelection == 4: #Sankey Diagram
            return data_class.format_sankey_diagram(data)

        return None
    
    
    def format_bar_chart(data: "data_class"):
        return data_class(data.name, None, data.value, None, None, None)

    def format_pie_chart(data: "data_class"):
        return data_class(data.name, None, data.value, None, None, None)

    def format_tree_map(data: "data_class"):
        return data_class(data.name, data.parent, data.value, None, None, None)

    def format_circle_packing(data: "data_class"):
        return data_class(data.name, data.parent, data.value, None, None, None)

    def format_sankey_diagram(data: "data_class"):
        return None
# ---------- end python_3_script ----------
python_3_script_2 = Python3Script(name="area", parent="retail", value=random_2, dataType="float", description="testDescription02", tags=panel_13)  # -> out, a; inputs tags: list; same code as python_3_script
select_graph_2 = ValueList({"Bar Graph": 0, "Pie Graph": 1, "Tree Map": 2, "Circle Packing": 3, "Sankey Diagram": 4}, selected="Circle Packing")
python_3_script_3 = Python3Script(graphSelection=select_graph_2, dataCollection=[python_3_script.a, python_3_script_2.a])  # -> out, a; inputs dataCollection: list
# ---------- python_3_script_3: Python ----------
"""Grasshopper Script Instance"""
import System
import Rhino
import Grasshopper

import rhinoscriptsyntax as rs

import json
from dataclasses import asdict, is_dataclass
from typing import Any, Type, TypeVar
from enum import Enum

T = TypeVar("T")

class data_class:

    name = ""
    parent = ""
    value = ""
    dataType = ""
    description = ""
    tags = []

    def __init__(self, name, parent, value, dataType, description, tags):

        if name is not None:
            self.name = name
        if parent is not None:
            self.parent = parent
        if value is not None:
            self.value = value
        if dataType is not None:
            self.dataType = dataType
        if description is not None:
            self.description = description
        if tags is not None:
            self.tags = tags

    def __bytes__(self):
        return json.dumps({
            "name": self.name,
            "parent": self.parent,
            "value": self.value,
            "dataType": self.dataType,
            "description": self.description,
            "tags": self.tags
        }).encode("utf-8")

    def from_bytes(data: bytes):
        d = json.loads(data.decode("utf-8"))
        return data_class(d["name"], d["parent"], d["value"], d["dataType"], d["description"], d["tags"])


    def format_data(data: "data_class", graphSelection):

        if graphSelection == 0: #Bar Graph
            return data_class.format_bar_chart(data)
        
        elif graphSelection == 1: #Pie Chart
            return data_class.format_pie_chart(data)
        
        elif graphSelection == 2: #Tree Map
            return data_class.format_tree_map(data)
        
        elif graphSelection == 3: #Circle Packing
            return data_class.format_circle_packing(data)
        
        elif graphSelection == 4: #Sankey Diagram
            return data_class.format_sankey_diagram(data)

        return None
    
    
    def format_bar_chart(data: "data_class"):
        return data_class(data.name, None, data.value, None, None, None)

    def format_pie_chart(data: "data_class"):
        return data_class(data.name, None, data.value, None, None, None)

    def format_tree_map(data: "data_class"):
        return data_class(data.name, data.parent, data.value, None, None, None)

    def format_circle_packing(data: "data_class"):
        return data_class(data.name, data.parent, data.value, None, None, None)

    def format_sankey_diagram(data: "data_class"):
        return None


class JsonHelper:

    def serialize(obj: Any, indent: int = None) -> str:
        """Serialize an object to a JSON string."""
        return json.dumps(JsonHelper._to_dict(obj), indent=indent)

    def deserialize(json_str: str, cls: Type[T] = None) -> Any:
        """Deserialize a JSON string. If cls is provided, map to that class."""
        data = json.loads(json_str)
        if cls is not None:
            return JsonHelper._from_dict(data, cls)
        return data

    def serialize_to_file(obj: Any, filepath: str, indent: int = 2) -> None:
        """Serialize an object and write it to a file."""
        with open(filepath, "w", encoding="utf-8") as f:
            json.dump(JsonHelper._to_dict(obj), f, indent=indent)

    def deserialize_from_file(filepath: str, cls: Type[T] = None) -> Any:
        """Read a JSON file and deserialize it. If cls is provided, map to that class."""
        with open(filepath, "r", encoding="utf-8") as f:
            data = json.load(f)
        if cls is not None:
            return JsonHelper._from_dict(data, cls)
        return data

    def _to_dict(obj: Any) -> Any:
        if is_dataclass(obj) and not isinstance(obj, type):
            return asdict(obj)
        if hasattr(obj, "__dict__"):
            return {k: JsonHelper._to_dict(v) for k, v in vars(obj).items()}
        if isinstance(obj, (list, tuple)):
            return [JsonHelper._to_dict(item) for item in obj]
        if isinstance(obj, dict):
            return {k: JsonHelper._to_dict(v) for k, v in obj.items()}
        return obj

    def _from_dict(data: Any, cls: Type[T]) -> T:
        if not isinstance(data, dict):
            return data
        import inspect
        params = inspect.signature(cls.__init__).parameters
        kwargs = {
            k: data[k]
            for k in params
            if k != "self" and k in data
        }
        return cls(**kwargs)


class GraphName(Enum):
    BAR_GRAPH = "Bar Graph"
    PIE_CHART = "Pie Chart"
    TREE_MAP = "Tree Map"
    CIRCLE_PACKING = "Circle Packing"
    SANKEY_DIAGRAM = "Sankey Diagram"

class graph_class:

    graph = None

    def __init__(self, selection):

        if selection is not None:
            self.GraphName = str(list(GraphName)[selection])
        

class DataCompiler(Grasshopper.Kernel.GH_ScriptInstance):
    def RunScript(self, graphSelection, dataCollection: list[object]):

        structuredData = []

        graph = graph_class(graphSelection)
        structuredData.append(graph)

        for d in dataCollection:
            data = data_class.from_bytes(d)
            formattedData = data_class.format_data(data, graphSelection)
            structuredData.append(formattedData)

        dataJson = JsonHelper.serialize(structuredData)

        return dataJson
# ---------- end python_3_script_3 ----------

# ==== cluster Cluster
L = ClusterInput()
lng = ListLength(List=L)
V = ClusterInput()
dom = ConstructDomain(DomainStart=0, DomainEnd=lng)
remap = RemapNumbers(Value=V, Source=Domain(0, 1), Target=dom)  # -> Mapped, Clipped
int = Integer(remap.Mapped)
int_2 = ClusterOutput(int)
