# Grasshopper definition port(1).gh (Grasshopper 1.0.8)

py3 = Python3Script(seed=Slider(3, range=0..10))  # -> A, B, C
# ---------- py3: Python ----------
import json
import random

# GH input:
# seed : int   (Integer Slider, e.g. 0..10000)

MIN_V = 15
MAX_V = 250

if seed is None:
    seed = 0

seed = int(seed)

# deterministic RNG from seed
rng = random.Random(seed)

data = [
    {"name": "Living",  "parent": "Indoor",  "value": rng.randint(MIN_V, MAX_V)},
    {"name": "Kitchen", "parent": "Indoor",  "value": rng.randint(MIN_V, MAX_V)},
    {"name": "Bedroom", "parent": "Terrace", "value": rng.randint(MIN_V, MAX_V)},
    {"name": "Deck",    "parent": "Outdoor", "value": rng.randint(MIN_V, MAX_V)},
    {"name": "Garden",  "parent": "Outdoor", "value": rng.randint(MIN_V, MAX_V)},
    {"name": "Pool",    "parent": "Outdoor", "value": rng.randint(MIN_V, MAX_V)},
]

# GH outputs:
# A: data (list of dicts)
# B: json_text (string)
# C: values_only (list of numbers)
A = data
B = json.dumps(data, indent=2)
C = [d["value"] for d in data]
# ---------- end py3 ----------
random = Random(Range=Domain(0, 10000), Number=Slider(5, range=0..10), Seed=8)
random_2 = Random(Range=Domain(0, 10000), Number=Slider(4, range=0..10), Seed=2)
panel = Panel("""tag1
tag2
tag3
tag4
tag5""")
panel_2 = Panel("""tag1
tag2
tag3""")
python_3_script = Python3Script(name="area", parent="residential", value=random, dataType="float", description="testDescription01", tags=panel)  # -> out, a; inputs tags: list
# ---------- python_3_script: Python ----------
"""Grasshopper Script Instance"""
import System
import Rhino
import Grasshopper

import rhinoscriptsyntax as rs
import json

class DataConstructor(Grasshopper.Kernel.GH_ScriptInstance):
    def RunScript(self,
            name,
            parent,
            value,
            dataType,
            description,
            tags: list[object]):
        data = data_class(name, parent, value, dataType, description, tags)
        byte = bytes(data)
        return byte


class data_class:

    name = ""
    parent = ""
    value = ""
    dataType = ""
    description = ""
    tags = []

    def __init__(self, name, parent, value, dataType, description, tags):

        if name is not None:
            self.name = name
        if parent is not None:
            self.parent = parent
        if value is not None:
            self.value = value
        if dataType is not None:
            self.dataType = dataType
        if description is not None:
            self.description = description
        if tags is not None:
            self.tags = tags

    def __bytes__(self):
        return json.dumps({
            "name": self.name,
            "parent": self.parent,
            "value": self.value,
            "dataType": self.dataType,
            "description": self.description,
            "tags": self.tags
        }).encode("utf-8")

    def from_bytes(data: bytes):
        d = json.loads(data.decode("utf-8"))
        return data_class(d["name"], d["parent"], d["value"], d["dataType"], d["description"], d["tags"])


    def format_data(data: "data_class", graphSelection):

        if graphSelection == 0: #Bar Graph
            return data_class.format_bar_chart(data)
        
        elif graphSelection == 1: #Pie Chart
            return data_class.format_pie_chart(data)
        
        elif graphSelection == 2: #Tree Map
            return data_class.format_tree_map(data)
        
        elif graphSelection == 3: #Circle Packing
            return data_class.format_circle_packing(data)
        
        elif graphSelection == 4: #Sankey Diagram
            return data_class.format_sankey_diagram(data)

        return None
    
    
    def format_bar_chart(data: "data_class"):
        return data_class(data.name, None, data.value, None, None, None)

    def format_pie_chart(data: "data_class"):
        return data_class(data.name, None, data.value, None, None, None)

    def format_tree_map(data: "data_class"):
        return data_class(data.name, data.parent, data.value, None, None, None)

    def format_circle_packing(data: "data_class"):
        return data_class(data.name, data.parent, data.value, None, None, None)

    def format_sankey_diagram(data: "data_class"):
        return None
# ---------- end python_3_script ----------
python_3_script_2 = Python3Script(name="area", parent="retail", value=random_2, dataType="float", description="testDescription02", tags=panel_2)  # -> out, a; inputs tags: list; same code as python_3_script
select_graph = ValueList({"Bar Graph": 0, "Pie Graph": 1, "Tree Map": 2, "Circle Packing": 3, "Sankey Diagram": 4}, selected="Circle Packing")
python_3_script_3 = Python3Script(graphSelection=select_graph, dataCollection=[python_3_script.a, python_3_script_2.a])  # -> out, a; inputs dataCollection: list
# ---------- python_3_script_3: Python ----------
"""Grasshopper Script Instance"""
import System
import Rhino
import Grasshopper

import rhinoscriptsyntax as rs

import json
from dataclasses import asdict, is_dataclass
from typing import Any, Type, TypeVar
from enum import Enum

T = TypeVar("T")

class data_class:

    name = ""
    parent = ""
    value = ""
    dataType = ""
    description = ""
    tags = []

    def __init__(self, name, parent, value, dataType, description, tags):

        if name is not None:
            self.name = name
        if parent is not None:
            self.parent = parent
        if value is not None:
            self.value = value
        if dataType is not None:
            self.dataType = dataType
        if description is not None:
            self.description = description
        if tags is not None:
            self.tags = tags

    def __bytes__(self):
        return json.dumps({
            "name": self.name,
            "parent": self.parent,
            "value": self.value,
            "dataType": self.dataType,
            "description": self.description,
            "tags": self.tags
        }).encode("utf-8")

    def from_bytes(data: bytes):
        d = json.loads(data.decode("utf-8"))
        return data_class(d["name"], d["parent"], d["value"], d["dataType"], d["description"], d["tags"])


    def format_data(data: "data_class", graphSelection):

        if graphSelection == 0: #Bar Graph
            return data_class.format_bar_chart(data)
        
        elif graphSelection == 1: #Pie Chart
            return data_class.format_pie_chart(data)
        
        elif graphSelection == 2: #Tree Map
            return data_class.format_tree_map(data)
        
        elif graphSelection == 3: #Circle Packing
            return data_class.format_circle_packing(data)
        
        elif graphSelection == 4: #Sankey Diagram
            return data_class.format_sankey_diagram(data)

        return None
    
    
    def format_bar_chart(data: "data_class"):
        return data_class(data.name, None, data.value, None, None, None)

    def format_pie_chart(data: "data_class"):
        return data_class(data.name, None, data.value, None, None, None)

    def format_tree_map(data: "data_class"):
        return data_class(data.name, data.parent, data.value, None, None, None)

    def format_circle_packing(data: "data_class"):
        return data_class(data.name, data.parent, data.value, None, None, None)

    def format_sankey_diagram(data: "data_class"):
        return None


class JsonHelper:

    def serialize(obj: Any, indent: int = None) -> str:
        """Serialize an object to a JSON string."""
        return json.dumps(JsonHelper._to_dict(obj), indent=indent)

    def deserialize(json_str: str, cls: Type[T] = None) -> Any:
        """Deserialize a JSON string. If cls is provided, map to that class."""
        data = json.loads(json_str)
        if cls is not None:
            return JsonHelper._from_dict(data, cls)
        return data

    def serialize_to_file(obj: Any, filepath: str, indent: int = 2) -> None:
        """Serialize an object and write it to a file."""
        with open(filepath, "w", encoding="utf-8") as f:
            json.dump(JsonHelper._to_dict(obj), f, indent=indent)

    def deserialize_from_file(filepath: str, cls: Type[T] = None) -> Any:
        """Read a JSON file and deserialize it. If cls is provided, map to that class."""
        with open(filepath, "r", encoding="utf-8") as f:
            data = json.load(f)
        if cls is not None:
            return JsonHelper._from_dict(data, cls)
        return data

    def _to_dict(obj: Any) -> Any:
        if is_dataclass(obj) and not isinstance(obj, type):
            return asdict(obj)
        if hasattr(obj, "__dict__"):
            return {k: JsonHelper._to_dict(v) for k, v in vars(obj).items()}
        if isinstance(obj, (list, tuple)):
            return [JsonHelper._to_dict(item) for item in obj]
        if isinstance(obj, dict):
            return {k: JsonHelper._to_dict(v) for k, v in obj.items()}
        return obj

    def _from_dict(data: Any, cls: Type[T]) -> T:
        if not isinstance(data, dict):
            return data
        import inspect
        params = inspect.signature(cls.__init__).parameters
        kwargs = {
            k: data[k]
            for k in params
            if k != "self" and k in data
        }
        return cls(**kwargs)


class GraphName(Enum):
    BAR_GRAPH = "Bar Graph"
    PIE_CHART = "Pie Chart"
    TREE_MAP = "Tree Map"
    CIRCLE_PACKING = "Circle Packing"
    SANKEY_DIAGRAM = "Sankey Diagram"

class graph_class:

    graph = None

    def __init__(self, selection):

        if selection is not None:
            self.GraphName = str(list(GraphName)[selection])
        

class DataCompiler(Grasshopper.Kernel.GH_ScriptInstance):
    def RunScript(self, graphSelection, dataCollection: list[object]):

        structuredData = []

        graph = graph_class(graphSelection)
        structuredData.append(graph)

        for d in dataCollection:
            data = data_class.from_bytes(d)
            formattedData = data_class.format_data(data, graphSelection)
            structuredData.append(formattedData)

        dataJson = JsonHelper.serialize(structuredData)

        return dataJson
# ---------- end python_3_script_3 ----------
panel_3 = Panel(py3.B)
panel_4 = Panel(python_3_script_3.a)
py3_2 = Python3Script(data=python_3_script_3.a, send=Toggle(True))  # -> A, B; inputs data: list, send: Boolean
# ---------- py3_2: Python ----------
import json
import hashlib
import urllib.request
import scriptcontext as sc

# GH input:
# data : list[dict]  (your treemap list: name,parent,value)
# send : bool

URL = "http://127.0.0.1:8765/update"

def stable_json(obj):
    return json.dumps(obj, ensure_ascii=False, sort_keys=True, separators=(",", ":"))

ok = False
msg = "send=False"

if send and data is not None:
    payload_text = stable_json(data)
    new_hash = hashlib.sha256(payload_text.encode("utf-8")).hexdigest()
    old_hash = sc.sticky.get("treemap_hash")

    if new_hash != old_hash:
        req = urllib.request.Request(
            URL,
            data=payload_text.encode("utf-8"),
            headers={"Content-Type": "application/json"},
            method="POST",
        )
        try:
            with urllib.request.urlopen(req, timeout=1.5) as r:
                _ = r.read()
            sc.sticky["treemap_hash"] = new_hash
            ok = True
            msg = "Posted update (changed)."
        except Exception as e:
            msg = "POST failed: {}".format(e)
    else:
        ok = True
        msg = "No change; skipped POST."

# GH outputs:
# A = ok
# B = msg
# ---------- end py3_2 ----------
panel_5 = Panel(py3_2.B)
panel_6 = Panel(py3_2.A)
